# Grasshopper definition TSP.gh (Grasshopper 1.0.7)
# plug-ins: Human

# ---- group: 1. connect to server
connect = Connect(connect=Button())  # -> status, connections
# ---------- connect: Python ----------
import urllib2, socket
import sys, math, os, json

t_o = 1

if not connect:
    local_file = ghenv.Component.OnPingDocument().FilePath
    if local_file == None:
        status = "Please save your Grasshopper file before connecting to Discover server"
    else:
        file_path = local_file.split("\\")
        file_dir = "\\".join(file_path)#[:-1])
        file_name = file_path[-1].split(".")[0]
        
        print(file_name)
        
        try:
            response = urllib2.urlopen('http://127.0.0.1:5000/api/v1.0/connect/' + urllib2.quote(file_name), timeout=t_o)
            html = response.read()
            result = json.loads(html)
            status = result["status"]
            connections = result["connections"]
        except urllib2.URLError:
            status = "Server not found"
        except socket.timeout:
            status = "Server timed out"
# ---------- end connect ----------
panel = Panel(connect.status)
bang = ExplodeTree(Data=simplify(graft(connect.connections)))  # -> Branch0, Branch1

# ---- group: 2. get inputs from server
file = ReadFile(File=bang.Branch0, PerLineParse=True)
get_inputs = GetInputs(connection=file)  # -> out, graft(inputs)
# ---------- get_inputs: Python ----------
import time, json, urllib2, socket

t_o = 1

try:
    response = urllib2.urlopen('http://127.0.0.1:5000/api/v1.0/get_inputs/', timeout=t_o)# + urllib2.quote(file_dir))
    html = response.read()
    inputs = json.loads(html)
    print "Received inputs from server"
except urllib2.URLError:
    inputs = []
    print "Could not connect to server"
except socket.timeout:
    inputs = []
    print "Server timed out"

#print inputs
# ---------- end get_inputs ----------
python = GhPythonScript(x=get_inputs.inputs)  # -> a
# ---------- python: Python ----------
a = x
# ---------- end python ----------
bang_2 = ExplodeTree(Data=simplify(python))

# ---- group: 4. capture screenshot
file_2 = ReadFile(File=bang.Branch1, PerLineParse=True)
screenshot = Screenshot(connection=file_2)  # -> out; inputs connection: list
# ---------- screenshot: Python ----------
import time, json, urllib2, socket
import Rhino
import System
import scriptcontext

t_o = 1

def make_view(view_name, views):
        new_view = views.Add(view_name, Rhino.Display.DefinedViewportProjection.Perspective, System.Drawing.Rectangle(0,0,800, 600), True)
        new_vp = new_view.MainViewport
        new_vp.WorldAxesVisible = False
        new_vp.ZoomExtents()
        return new_view

def capture_screenshot():
    views = Rhino.RhinoDoc.ActiveDoc.Views
    view_name = "Discover"
    
    view_list = views.GetViewList(True, True)
    view_names = [vp.MainViewport.Name for vp in view_list]
    
    if view_name not in view_names:
        view = make_view(view_name, views)
    else:
        view = view_list[view_names.index(view_name)]
    
    bitmap = view.CaptureToBitmap(False, False, False)
    
    file_path = ghenv.Component.OnPingDocument().FilePath.split("\\")
    
    req = urllib2.Request('http://127.0.0.1:5000/api/v1.0/get_ss_path/')
    req.add_header('Content-Type', 'application/json')
    
    response = urllib2.urlopen(req, timeout=t_o)
    html = response.read()
    result = json.loads(html)
    
    if result["status"] == "success":
        path = result["path"]
    
    save_dir = ".".join([path, "png"])
    
    print "Saved screenshot to", save_dir
    
    bitmap.Save(save_dir)

def ping_server():
    try:
        req = urllib2.Request('http://127.0.0.1:5000/api/v1.0/ss_done/')
        req.add_header('Content-Type', 'application/json')
        
        response = urllib2.urlopen(req, timeout=t_o)
        html = response.read()
        result = json.loads(html)
    
        print result["status"]
    
    except urllib2.URLError:
        print "Could not connect to server"

try:
    req = urllib2.Request('http://127.0.0.1:5000/api/v1.0/job_running/')
    req.add_header('Content-Type', 'application/json')
    
    response = urllib2.urlopen(req, timeout=t_o)
    html = response.read()
    result = json.loads(html)
    
    if result:
        capture_screenshot()
        ping_server()
    else:
        print "No job running"
        
except urllib2.URLError:
    print "Could not connect to server"
except socket.timeout:
    print "Server timed out"
# ---------- end screenshot ----------
panel_2 = Panel(screenshot)

# ----
int = Integer(bang_2)
pipeline = GeometryPipeline(
    GroupByLayer=False,
    GroupByType=False,
    IncludeHidden=True,
    IncludeLocked=True,
    LayerFilter="start",
    NameFilter="*",
    SublayerFiltering=False,
    TypeFilter=1)
pipeline_2 = GeometryPipeline(
    GroupByLayer=False,
    GroupByType=False,
    IncludeHidden=True,
    IncludeLocked=True,
    LayerFilter="cities",
    NameFilter="*",
    SublayerFiltering=False,
    TypeFilter=1)
item = ListItem(List=pipeline_2, Index=int, Wrap=True)
merge = Merge(Data1=flatten(pipeline), Data2=flatten(item))
pline = PolyLine(Vertices=merge, Closed=True)
previewlw = CustomPreviewLineweights(Geometry=pline, Shader=ColourSwatch(SwatchColor=RGB(255, 0, 0)), Thickness=Slider(2, range=0..10))
len = Length(Curve=pline)

# ---- group: 3. send outputs to server
merge_2 = Merge(Data1=len)
send_outputs = SendOutputs(outputs=merge_2)  # -> out; inputs outputs: list
# ---------- send_outputs: Python ----------
import time, json, urllib2, socket

t_o = 1

#try:
#    response = urllib2.urlopen('http://127.0.0.1:5000/api/v1.0/set_outputs/' + urllib2.quote(file_dir))
#    html = response.read()
#    inputs = json.loads(html)
#except urllib2.URLError:
#    inputs = []
#    print "could not connect to server"

try:
    req = urllib2.Request('http://127.0.0.1:5000/api/v1.0/set_outputs/')
    req.add_header('Content-Type', 'application/json')
    
    response = urllib2.urlopen(req, json.dumps(outputs), timeout=t_o)
    html = response.read()
    result = json.loads(html)

    print result["status"]

except urllib2.URLError:
    print "could not connect to server"
except socket.timeout:
    print "Server timed out"
# ---------- end send_outputs ----------
panel_3 = Panel(send_outputs)
