# Grasshopper definition bridge-constrained.gh (Grasshopper 1.0.7)
# plug-ins: Karamba

# ---- group: 1. connect to server
connect = Connect(connect=Button())  # -> status, connections
# ---------- connect: Python ----------
import urllib2, socket
import sys, math, os, json

t_o = 1

if not connect:
    local_file = ghenv.Component.OnPingDocument().FilePath
    if local_file == None:
        status = "Please save your Grasshopper file before connecting to Discover server"
    else:
        file_path = local_file.split("\\")
        file_dir = "\\".join(file_path)#[:-1])
        file_name = file_path[-1].split(".")[0]
        
        print(file_name)
        
        try:
            response = urllib2.urlopen('http://127.0.0.1:5000/api/v1.0/connect/' + urllib2.quote(file_name), timeout=t_o)
            html = response.read()
            result = json.loads(html)
            status = result["status"]
            connections = result["connections"]
        except urllib2.URLError:
            status = "Server not found"
        except socket.timeout:
            status = "Server timed out"
# ---------- end connect ----------
bang = ExplodeTree(Data=simplify(graft(connect.connections)))  # -> Branch0, Branch1
panel = Panel(connect.status)

# ---- group: 4. capture screenshot
file = ReadFile(File=bang.Branch1, PerLineParse=True)
screenshot = Screenshot(connection=file)  # -> out; inputs connection: list
# ---------- screenshot: Python ----------
import time, json, urllib2, socket
import Rhino
import System
import scriptcontext

t_o = 1

def make_view(view_name, views):
        new_view = views.Add(view_name, Rhino.Display.DefinedViewportProjection.Perspective, System.Drawing.Rectangle(0,0,800, 600), True)
        new_vp = new_view.MainViewport
        new_vp.WorldAxesVisible = False
        new_vp.ZoomExtents()
        return new_view

def capture_screenshot():
    views = Rhino.RhinoDoc.ActiveDoc.Views
    view_name = "Discover"
    
    view_list = views.GetViewList(True, True)
    view_names = [vp.MainViewport.Name for vp in view_list]
    
    if view_name not in view_names:
        view = make_view(view_name, views)
    else:
        view = view_list[view_names.index(view_name)]
    
    bitmap = view.CaptureToBitmap(False, False, False)
    
    file_path = ghenv.Component.OnPingDocument().FilePath.split("\\")
    
    req = urllib2.Request('http://127.0.0.1:5000/api/v1.0/get_ss_path/')
    req.add_header('Content-Type', 'application/json')
    
    response = urllib2.urlopen(req, timeout=t_o)
    html = response.read()
    result = json.loads(html)
    
    if result["status"] == "success":
        path = result["path"]
    
    save_dir = ".".join([path, "png"])
    
    print "Saved screenshot to", save_dir
    
    bitmap.Save(save_dir)

def ping_server():
    try:
        req = urllib2.Request('http://127.0.0.1:5000/api/v1.0/ss_done/')
        req.add_header('Content-Type', 'application/json')
        
        response = urllib2.urlopen(req, timeout=t_o)
        html = response.read()
        result = json.loads(html)
    
        print result["status"]
    
    except urllib2.URLError:
        print "Could not connect to server"

try:
    req = urllib2.Request('http://127.0.0.1:5000/api/v1.0/job_running/')
    req.add_header('Content-Type', 'application/json')
    
    response = urllib2.urlopen(req, timeout=t_o)
    html = response.read()
    result = json.loads(html)
    
    if result:
        capture_screenshot()
        ping_server()
    else:
        print "No job running"
        
except urllib2.URLError:
    print "Could not connect to server"
except socket.timeout:
    print "Server timed out"
# ---------- end screenshot ----------
panel_2 = Panel(screenshot)

# ---- group: 2. get inputs from server
file_2 = ReadFile(File=bang.Branch0, PerLineParse=True)
get_inputs = GetInputs(connection=file_2)  # -> out, inputs
# ---------- get_inputs: Python ----------
import time, json, urllib2, socket

t_o = 1

try:
    response = urllib2.urlopen('http://127.0.0.1:5000/api/v1.0/get_inputs/', timeout=t_o)# + urllib2.quote(file_dir))
    html = response.read()
    inputs = json.loads(html)
    print "Received inputs from server"
except urllib2.URLError:
    inputs = []
    print "Could not connect to server"
except socket.timeout:
    inputs = []
    print "Server timed out"

#print inputs
# ---------- end get_inputs ----------
python = GhPythonScript(x=get_inputs.inputs)  # -> a
# ---------- python: Python ----------
a = x
# ---------- end python ----------
bang_2 = ExplodeTree(Data=simplify(python))  # -> Branch0, Branch1

# ----
pt = ConstructPoint(XCoordinate=0, YCoordinate=0, ZCoordinate=0)
Y = UnitY(Factor=1)
line = LineSDL(Start=pt, Direction=Y, Length=Slider(10, range=0..10))
divide = DivideCurve(Curve=line, Count=Slider(5, range=0..10), Kinks=False)  # -> Points, Tangents, Parameters
Z = UnitZ(Factor=bang_2.Branch0)
move = Move(Geometry=divide.Points, Motion=Z)  # -> Geometry, Transform
python_2 = PythonScript(pts1=divide.Points, pts2=move.Geometry, types=bang_2.Branch1)  # -> out, lines; inputs pts1: list, pts2: list, types: list
# ---------- python_2: Python ----------
import rhinoscriptsyntax as rs

lines = []

for i, type in enumerate(types):
    if type == 1:
        lines.append(rs.AddLine(pts1[i], pts2[i+1]))
    if type == 2:
        lines.append(rs.AddLine(pts2[i], pts1[i+1]))
    if type == 3:
        lines.append(rs.AddLine(pts1[i], pts2[i+1]))
        lines.append(rs.AddLine(pts2[i], pts1[i+1]))
# ---------- end python_2 ----------
pline = PolyLine(Vertices=divide.Points, Closed=False)
pline_2 = PolyLine(Vertices=move.Geometry, Closed=False)
ln = Line(StartPoint=divide.Points, EndPoint=move.Geometry)
end = EndPoints(Curve=line)  # -> Start, End
explode = Explode(Curve=pline, Recursive=True)  # -> Segments, Vertices
explode_2 = Explode(Curve=pline_2, Recursive=True)  # -> Segments, Vertices
merge = Merge(Data1=end.Start, Data2=end.End)  # -> flatten(Result)
number_slider = Slider(15, range=0..100)
merge_2 = Merge(Data1=ln, Data2=explode_2.Segments, Data3=python_2.lines)  # -> flatten(Result)
Z_2 = UnitZ(Factor=Slider(10, range=0..10))
rev = Reverse(Vector=Z_2)
division = Division(A=number_slider, B="4")
supp = SupportKaramba(PosInd=merge, menu=[buttons(on, on, on, on, on, off)])
cross_section = CrossSectionKaramba3D(
    FamilyNameOfCrossSection="DefaultCroSec",
    ElementIdentifier="structure",
    Material=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,
    Diameter_cm=number_slider,
    WallThickness_cm=division,
    mode="Circular Hollow")
loads = LoadsKaramba(Vector=rev, BeamIdentifierS="road", LCase=0, mode="Uniform Line", menu=[buttons(off, on, off)])
linetobeam = LineToBeamKaramba(Line=merge_2, New=True, Remove=True, LimitDistance_m=0.005, BeamIdentifier="structure")  # -> Points, Element, Info
linetobeam_2 = LineToBeamKaramba(Line=explode.Segments, New=True, Remove=True, LimitDistance_m=0.005, BeamIdentifier="road")  # -> Points, Element, Info
merge_3 = Merge(Data1=linetobeam_2.Element, Data2=linetobeam.Element)  # -> flatten(Result)
range = Range(Domain=Domain(0, 1), Steps=10)
gradient = Gradient(
    LowerLimit=0,
    UpperLimit=1,
    Parameter=range,
    stops=[0.253: RGB(255, 0, 0), 0.497: RGB(99, 154, 199), 0.751: RGB(255, 0, 0)])
assemble = AssembleModelKaramba(Elem=merge_3, Support=supp, Load=loads, CrossSection=cross_section, LimitDistance_m=0.005)  # -> Model, Info, Mass_kg, CenterOfGravity
analyzethi = AnalyzeThIKaramba(Model=assemble.Model)  # -> CalculatedModel, MaximumDisplacement_m, ResultingForceOfGravity_kN, ElasticEnergy_kNm
modelview = ModelViewKaramba(
    Model=analyzethi.CalculatedModel,
    LoadCaseFactorsForLinearSuperposition=1,
    IndexIncrementOfVisibleLoadcase=0,
    ListOfColorsForColoringPlots=gradient)  # -> Model, DeformedMesh, DeformedAxes, DeformedModel
beamview = BeamViewKaramba(Model=modelview.Model)  # -> Model, MeshesOfRenderedBeams, DeformedBeamAxes, LegendColors, LegendTags
python_3 = PythonScript(x=beamview.LegendTags)  # -> out, a; inputs x: list
# ---------- python_3: Python ----------
import re

a = []

x.pop(0)

for val in x:
    try:
        a.append( float(re.sub(r'[^\d.-e+]+', '', val)) )
    except ValueError:
        continue
# ---------- end python_3 ----------
abs = Absolute(Value=python_3.a)
bnd = Bounds(Numbers=abs)
dedomain = DeconstructDomain(Domain=bnd)  # -> Start, End
max_utilization_percentage = Panel(dedomain.End)
displacement_min = Panel(analyzethi.MaximumDisplacement_m)
material_min = Panel(assemble.Mass_kg)

# ---- group: 3. send outputs to server
merge_4 = Merge(Data1=flatten(displacement_min), Data2=flatten(material_min), Data3=flatten(max_utilization_percentage))
send_outputs = SendOutputs(outputs=merge_4)  # -> out; inputs outputs: list
# ---------- send_outputs: Python ----------
import time, json, urllib2, socket

t_o = 1

#try:
#    response = urllib2.urlopen('http://127.0.0.1:5000/api/v1.0/set_outputs/' + urllib2.quote(file_dir))
#    html = response.read()
#    inputs = json.loads(html)
#except urllib2.URLError:
#    inputs = []
#    print "could not connect to server"

try:
    req = urllib2.Request('http://127.0.0.1:5000/api/v1.0/set_outputs/')
    req.add_header('Content-Type', 'application/json')
    
    response = urllib2.urlopen(req, json.dumps(outputs), timeout=t_o)
    html = response.read()
    result = json.loads(html)

    print result["status"]

except urllib2.URLError:
    print "could not connect to server"
except socket.timeout:
    print "Server timed out"
# ---------- end send_outputs ----------
panel_3 = Panel(send_outputs)
