# Grasshopper definition bridge.gh (Grasshopper 0.9.76)
# plug-ins: Karamba, Python Interpreter

# ---- group: get inputs from job results
python = PythonScript(jobName="_job name_", id="0")  # -> out, inputs
# ---------- python: Python ----------
path = ghenv.Component.OnPingDocument().FilePath
path = path.split("\\")
path = "\\".join(path[:-1] + [jobName, "results.tsv"])

with open(path, 'r') as f:
    data = f.readlines()

headers = data.pop(0).split('\t')

designs = {}
for d in data:
    line = d.split('\t')
    designs[ int(line[headers.index('id')]) ] = [x for i,x in enumerate(line) if "[in" in headers[i] or "[ser" in headers[i]]

inputs = designs[int(id)]
# ---------- end python ----------

# ---- group: get inputs from file
python_2 = PythonScript()  # -> out, path
# ---------- python_2: Python ----------
path = ghenv.Component.OnPingDocument().FilePath
path = path.split("\\")
path = "\\".join(path[:-1] + ["inputs.txt"])
# ---------- end python_2 ----------
file = ReadFile(File=python_2.path, PerLineParse=True)

# ----
data_in = Panel(file)
bang = ExplodeTree(Data=simplify(graft(file)))  # -> Branch0, Branch1, Branch2, Branch3, Branch4, Branch5, Branch6, Branch7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
merge = Merge(Data1=bang.Branch0, Data2=bang.Branch1, Data3=bang.Branch2, Data4=bang.Branch3, Data5=bang.Branch4, Data6=bang.Branch5)  # -> flatten(Result)
merge_2 = Merge(Data1=bang.Branch6, Data2=bang.Branch7, Data3=bang.Branch8, Data4=bang.Branch9, Data5=bang.Branch10)  # -> flatten(Result)
pt = ConstructPoint(XCoordinate=0, YCoordinate=0, ZCoordinate=0)
Y = UnitY(Factor=1)
genes = GenePool(Decimals=2, Maximum=5, Minimum=0, Value=[0, 2.11, 2.7, 2.98, 2.17, 0])
genes_2 = GenePool(Decimals=2, Maximum=3.99, Minimum=0, Value=[0, 2.66, 0.88, 2.39, 0])
line = LineSDL(Start=pt, Direction=Y, Length=Slider(10, range=0..10))
divide = DivideCurve(Curve=line, Count=Slider(5, range=0..10), Kinks=False)  # -> Points, Tangents, Parameters
round = Round(Number=merge_2)  # -> Nearest, Floor, Ceiling
Z = UnitZ(Factor=merge)
move = Move(Geometry=divide.Points, Motion=Z)  # -> Geometry, Transform
python_3 = PythonScript(pts1=divide.Points, pts2=move.Geometry, types=round.Floor)  # -> out, lines; inputs pts1: list, pts2: list, types: list
# ---------- python_3: Python ----------
import rhinoscriptsyntax as rs

lines = []

for i, type in enumerate(types):
    if type == 1:
        lines.append(rs.AddLine(pts1[i], pts2[i+1]))
    if type == 2:
        lines.append(rs.AddLine(pts2[i], pts1[i+1]))
    if type == 3:
        lines.append(rs.AddLine(pts1[i], pts2[i+1]))
        lines.append(rs.AddLine(pts2[i], pts1[i+1]))
# ---------- end python_3 ----------
pline = PolyLine(Vertices=divide.Points, Closed=False)
pline_2 = PolyLine(Vertices=move.Geometry, Closed=False)
ln = Line(StartPoint=divide.Points, EndPoint=move.Geometry)
end = EndPoints(Curve=line)  # -> Start, End
explode = Explode(Curve=pline, Recursive=True)  # -> Segments, Vertices
explode_2 = Explode(Curve=pline_2, Recursive=True)  # -> Segments, Vertices
merge_3 = Merge(Data1=end.Start, Data2=end.End)  # -> flatten(Result)
merge_4 = Merge(Data1=ln, Data2=explode_2.Segments, Data3=python_3.lines)  # -> flatten(Result)
Z_2 = UnitZ(Factor=Slider(10, range=0..10))
rev = Reverse(Vector=Z_2)
linetobeam = LineToBeamKaramba(Line=merge_4, New=True, Remove=True, LimitDistance_m=0.005, BeamIdentifier="structure")  # -> Points, Element, Info
linetobeam_2 = LineToBeamKaramba(Line=explode.Segments, New=True, Remove=True, LimitDistance_m=0.005, BeamIdentifier="road")  # -> Points, Element, Info
loads = LoadsKaramba(Vector=rev, BeamIdentifierS="road", LCase=0, mode="Uniform Line", menu=[buttons(off, on, off)])
supp = SupportKaramba(PosInd=merge_3, menu=[buttons(on, on, on, on, on, off)])
merge_5 = Merge(Data1=linetobeam_2.Element, Data2=linetobeam.Element)  # -> flatten(Result)
assemble = AssembleModelKaramba(Elem=merge_5, Support=supp, Load=loads, LimitDistance_m=0.005)  # -> Model, Info, Mass_kg, CenterOfGravity
analyzethi = AnalyzeThIKaramba(Model=assemble.Model)  # -> CalculatedModel, MaximumDisplacement_m, ResultingForceOfGravity_kN, ElasticEnergy_kNm
modelview = ModelViewKaramba(Model=analyzethi.CalculatedModel, LoadCaseFactorsForLinearSuperposition=1, IndexIncrementOfVisibleLoadcase=0)  # -> Model, DeformedMesh, DeformedAxes, DeformedModel
beamview = BeamViewKaramba(Model=modelview.Model)  # -> Model, MeshesOfRenderedBeams, DeformedBeamAxes, LegendColors, LegendTags
python_4 = PythonScript(x=beamview.LegendTags)  # -> out, a; inputs x: list
# ---------- python_4: Python ----------
import re

a = []

x.pop(0)

for val in x:
    try:
        a.append( float(re.sub(r'[^\d.-e+]+', '', val)) )
    except ValueError:
        continue
# ---------- end python_4 ----------
abs = Absolute(Value=python_4.a)
bnd = Bounds(Numbers=abs)
dedomain = DeconstructDomain(Domain=bnd)  # -> Start, End
max_utilization_percentage = Panel(dedomain.End)
displacement_min = Panel(analyzethi.MaximumDisplacement_m)
material_min = Panel(assemble.Mass_kg)
merge_6 = Merge(Data1=flatten(displacement_min), Data2=flatten(material_min), Data3=flatten(max_utilization_percentage))

# ---- group: screenshot
python_5 = PythonScript()  # -> out, path
# ---------- python_5: Python ----------
path = ghenv.Component.OnPingDocument().FilePath
path = path.split("\\")
path = "\\".join(path[:-1] + ["gh.ping"])
# ---------- end python_5 ----------
file_2 = ReadFile(File=python_5.path, PerLineParse=True)
python_6 = PythonScript(id=file_2)  # -> out
# ---------- python_6: Python ----------
import pickle
import rhinoscriptsyntax as rs

localFolder = "\\".join(ghenv.Component.OnPingDocument().FilePath.split("\\")[:-1]) + "\\"

with open(localFolder + "meta.file", 'rb') as f:
    meta = pickle.load(f)

jobID = meta['jobID']
#    designID = meta['designID']

imageFolder = localFolder + str(jobID) + "\\images\\"
imageName = imageFolder + str(id) + ".png"
rs.Command("_-ViewCaptureToFile \n\"" + imageName + "\"\n _Enter")

outputFile = localFolder + "python.ping"
with open(outputFile, 'w') as f:
    f.write('ack')

print "complete"
# ---------- end python_6 ----------

# ----
data_out = Panel(merge_6)

# ---- group: write to output file
python_7 = PythonScript(data=merge_6)  # -> out; inputs data: list
# ---------- python_7: Python ----------
import pickle
import rhinoscriptsyntax as rs

localFolder = "\\".join(ghenv.Component.OnPingDocument().FilePath.split("\\")[:-1]) + "\\"

outputFile = localFolder + "outputs.txt"
with open(outputFile, 'w') as f:
    f.write('\n'.join([str(x) for x in data]))

print "complete"
# ---------- end python_7 ----------
