# Grasshopper definition grid.gh (Grasshopper 0.9.76)
# plug-ins: Python Interpreter

# ---- group: get inputs from job results
python = PythonScript(jobName="_job name_", id="0")  # -> out, inputs
# ---------- python: Python ----------
path = ghenv.Component.OnPingDocument().FilePath
path = path.split("\\")
path = "\\".join(path[:-1] + [jobName, "results.tsv"])

with open(path, 'r') as f:
    data = f.readlines()

headers = data.pop(0).split('\t')

designs = {}
for d in data:
    line = d.split('\t')
    designs[ int(line[headers.index('id')]) ] = [x for i,x in enumerate(line) if "[in" in headers[i] or "[ser" in headers[i]]

inputs = designs[int(id)]
# ---------- end python ----------

# ---- group: get inputs from file
python_2 = PythonScript()  # -> out, path
# ---------- python_2: Python ----------
path = ghenv.Component.OnPingDocument().FilePath
path = path.split("\\")
path = "\\".join(path[:-1] + ["inputs.txt"])
# ---------- end python_2 ----------
file = ReadFile(File=python_2.path, PerLineParse=True)

# ----
genes = GenePool(
    Decimals=2,
    Maximum=2.99,
    Minimum=0,
    Value=[0.1220258478, 0.2622682871, 1.882439865, 1.099572845, 0.8894917986, 1.393539092, 0.6604541749, 0.08817211659, 0.2905419103, 2.929504066, 2.222704386, 2.322042178, 1.759427169, 1.016563543, 0.02374773407, 1.17013253, 1.674641398, 2.958922725, 0.09510085215, 2.217230817, 2.302600101, 0.9492934207, 1.799687171, 1.188400383, 0.3184272651])
data_in = Panel(file)
bang = ExplodeTree(Data=simplify(graft(file)))
round = Round(Number=genes)  # -> Nearest, Floor, Ceiling

# ---- group: unpack series
python_3 = PythonScript(x=bang)  # -> out, a
# ---------- python_3: Python ----------
import json

a = json.loads(x)
# ---------- end python_3 ----------

# ----
number_slider = Slider(5, range=0..10)
int = Integer(python_3.a)
series = Series(Start=0, Step=1, Count=number_slider)
bnd = Bounds(Numbers=flatten(int))
pt = ConstructPoint(XCoordinate=0, YCoordinate=0, ZCoordinate=0)
X = UnitX(Factor=series)
Y = UnitY(Factor=series)
move = Move(Geometry=pt, Motion=X)  # -> Geometry, Transform
gradient = Gradient(
    LowerLimit=0,
    UpperLimit=bnd,
    Parameter=int,
    stops=[0: RGB(234, 38, 0), 0.25: RGB(234, 126, 0), 0.5: RGB(254, 244, 84), 0.75: RGB(173, 203, 249), 1: RGB(75, 107, 169)])
division = Division(A=number_slider, B=Slider(2.5, range=0..10))
move_2 = Move(Geometry=graft(move.Geometry), Motion=Y)  # -> flatten(Geometry), Transform
pt_2 = ConstructPoint(XCoordinate=division, YCoordinate=division, ZCoordinate=0)
dist = Distance(PointA=move_2.Geometry, PointB=pt_2)
dots = DotDisplay(Point=move_2.Geometry, Colour=gradient, Size=Slider(0.2, range=0..1))
subtraction = Subtraction(A=int, B=dist)
abs = Absolute(Value=subtraction)
ma = MassAddition(Input=abs)  # -> Result, PartialResults
merge = Merge(Data1=flatten(ma.Result))

# ---- group: screenshot
python_4 = PythonScript()  # -> out, path
# ---------- python_4: Python ----------
path = ghenv.Component.OnPingDocument().FilePath
path = path.split("\\")
path = "\\".join(path[:-1] + ["gh.ping"])
# ---------- end python_4 ----------
file_2 = ReadFile(File=python_4.path, PerLineParse=True)
python_5 = PythonScript(id=file_2)  # -> out
# ---------- python_5: Python ----------
import pickle
import rhinoscriptsyntax as rs

localFolder = "\\".join(ghenv.Component.OnPingDocument().FilePath.split("\\")[:-1]) + "\\"

with open(localFolder + "meta.file", 'rb') as f:
    meta = pickle.load(f)

jobID = meta['jobID']
#    designID = meta['designID']

imageFolder = localFolder + str(jobID) + "\\images\\"
imageName = imageFolder + str(id) + ".png"
rs.Command("_-ViewCaptureToFile \n\"" + imageName + "\"\n _Enter")

outputFile = localFolder + "python.ping"
with open(outputFile, 'w') as f:
    f.write('ack')

print "complete"
# ---------- end python_5 ----------

# ----
data_out = Panel(merge)

# ---- group: write to output file
python_6 = PythonScript(data=merge)  # -> out; inputs data: list
# ---------- python_6: Python ----------
import pickle
import rhinoscriptsyntax as rs

localFolder = "\\".join(ghenv.Component.OnPingDocument().FilePath.split("\\")[:-1]) + "\\"

outputFile = localFolder + "outputs.txt"
with open(outputFile, 'w') as f:
    f.write('\n'.join([str(x) for x in data]))

print "complete"
# ---------- end python_6 ----------
