# Grasshopper definition salesman.gh (Grasshopper 0.9.76)
# plug-ins: Python Interpreter, HDTReference

# ---- group: get inputs from file
python = PythonScript()  # -> out, path
# ---------- python: Python ----------
path = ghenv.Component.OnPingDocument().FilePath
path = path.split("\\")
path = "\\".join(path[:-1] + ["inputs.txt"])
# ---------- end python ----------
file = ReadFile(File=python.path, PerLineParse=True)

# ---- group: get inputs from job results
python_2 = PythonScript(jobName="_job name_", id="0")  # -> out, inputs
# ---------- python_2: Python ----------
path = ghenv.Component.OnPingDocument().FilePath
path = path.split("\\")
path = "\\".join(path[:-1] + [jobName, "results.tsv"])

with open(path, 'r') as f:
    data = f.readlines()

headers = data.pop(0).split('\t')

designs = {}
for d in data:
    line = d.split('\t')
    designs[ int(line[headers.index('id')]) ] = [x for i,x in enumerate(line) if "[in" in headers[i]]

inputs = designs[int(id)]
# ---------- end python_2 ----------

# ----
bang = ExplodeTree(Inputs=simplify(graft(file)))
data_in = Panel(file)
pipeline = GeometryPipeline(
    GroupByLayer=False,
    GroupByType=False,
    IncludeHidden=True,
    IncludeLocked=True,
    LayerFilter="start",
    NameFilter="*",
    TypeFilter=1)
pipeline_2 = GeometryPipeline(
    GroupByLayer=False,
    GroupByType=False,
    IncludeHidden=True,
    IncludeLocked=True,
    LayerFilter="cities",
    NameFilter="*",
    TypeFilter=1)

# ---- group: unpack series
python_3 = PythonScript(x=bang)  # -> out, a
# ---------- python_3: Python ----------
import json

a = json.loads(x)
# ---------- end python_3 ----------

# ----
int = Integer(python_3.a)
item = ListItem(List=pipeline_2, Index=int, Wrap=True)
merge = Merge(Data1=flatten(pipeline), Data2=flatten(item))
pline = PolyLine(Vertices=merge, Closed=True)
previewlw = CustomPreviewLineweights(Geometry=pline, Shader=ColourSwatch(SwatchColor=RGB(255, 0, 0)), Thickness=Slider(2, range=0..10))
len = Length(Curve=pline)
merge_2 = Merge(Data1=flatten(len))

# ---- group: screenshot
python_4 = PythonScript()  # -> out, path
# ---------- python_4: Python ----------
path = ghenv.Component.OnPingDocument().FilePath
path = path.split("\\")
path = "\\".join(path[:-1] + ["gh.ping"])
# ---------- end python_4 ----------
file_2 = ReadFile(File=python_4.path, PerLineParse=True)
python_5 = PythonScript(id=file_2)  # -> out
# ---------- python_5: Python ----------
import pickle
import rhinoscriptsyntax as rs

localFolder = "\\".join(ghenv.Component.OnPingDocument().FilePath.split("\\")[:-1]) + "\\"

with open(localFolder + "meta.file", 'rb') as f:
    meta = pickle.load(f)

jobID = meta['jobID']
#    designID = meta['designID']

imageFolder = localFolder + str(jobID) + "\\images\\"
imageName = imageFolder + str(id) + ".png"
rs.Command("_-ViewCaptureToFile \n\"" + imageName + "\"\n _Enter")

outputFile = localFolder + "python.ping"
with open(outputFile, 'w') as f:
    f.write('ack')

print "complete"
# ---------- end python_5 ----------

# ----
data_out = Panel(merge_2)

# ---- group: write to output file
python_6 = PythonScript(data=merge_2)  # -> out; inputs data: list
# ---------- python_6: Python ----------
import pickle
import rhinoscriptsyntax as rs

localFolder = "\\".join(ghenv.Component.OnPingDocument().FilePath.split("\\")[:-1]) + "\\"

outputFile = localFolder + "outputs.txt"
with open(outputFile, 'w') as f:
    f.write('\n'.join([str(x) for x in data]))

print "complete"
# ---------- end python_6 ----------
